# Dynamo graph 002.dyn (Dynamo 1.3.3.4111)

# group: Parameters of BoundryBox
lenght = CodeBlock { 160; }  # frozen
width = CodeBlock { 150; }

# group: A Line ( Lenght=Lengh, XY plane on l/2<x<l/2)
code_block = CodeBlock(l=lenght) { point5 = Point.ByCoordinates(-l/2, 0, 0); point6 = Point.ByCoordinates(l/2, 0, 0); }
byStartPointEndPoint = Line.ByStartPointEndPoint(startPoint=code_block.point5, endPoint=code_block.point6)

# group: distance between the panels
distance_between_slices = CodeBlock { 9; }

# group: list of numbers between end and start of box, divided by interval "DistanceBetweenSlice"
code_block_2 = CodeBlock(len=lenght, Dis=distance_between_slices) { -len/2..len/2..Dis; }

# group: PointsOnLinebased on number
count = List.Count(code_block_2)
code_block_3 = CodeBlock(n=count) { 0..1..#n; }
pointAtParameter = Curve.PointAtParameter(curve=byStartPointEndPoint, param=code_block_3)

# group: Slicing Planes
byOrigin = CoordinateSystem.ByOrigin(pointAtParameter)
XYPlane = CoordinateSystem.XYPlane(byOrigin)
YZPlane = CoordinateSystem.YZPlane(byOrigin)

# group: Create Half of Eclipse on XY plane
code_block_4 = CodeBlock(x=lenght) { x/2; }
code_block_5 = CodeBlock { 0; 180; }
byPlaneRadiiAngles = EllipseArc.ByPlaneRadiiAngles(arg1=code_block_4, arg2=width, arg3=code_block_5.out0, arg4=code_block_5.out1)
intersect = Geometry.Intersect(geometry=byPlaneRadiiAngles, other=YZPlane@L1)

# group: ListOfPointsOnEclipse
code_block_6 = CodeBlock { 1; }
flatten = List.Flatten(list=intersect, amt=code_block_6)

# group: list of numbers between end and start of box, divided by interval "DistanceBetweenSlice"
code_block_7 = CodeBlock(len=lenght, Dis=distance_between_slices) { -len/2..len/2..Dis; }

# group: Botttom Curve
code_block_8 = CodeBlock { 10; 2; 70; 0.2; 1; }
harmonic = Custom[Harmonic](xValueOfPoints=code_block_7, NumberOfCyclesFirstWave=code_block_8.out0, NumberOfCyclesSecondWave=code_block_8.out1, HeightOfCurve=code_block_8.out2, RatioOfFirstWaveLenght=code_block_8.out3, RatioOfSecondWaveLenght=code_block_8.out4)  # Creating harmonic waves by combining Cos waves
code_block_9 = CodeBlock(points=harmonic.points) { points; }
code_block_10 = CodeBlock(polycurve=harmonic.polycurve) { polycurve; }

# group: Middle Curve
code_block_11 = CodeBlock { 10; 2; 120; 0.1; 0.5; }
harmonic_2 = Custom[Harmonic](xValueOfPoints=code_block_7, NumberOfCyclesFirstWave=code_block_11.out0, NumberOfCyclesSecondWave=code_block_11.out1, HeightOfCurve=code_block_11.out2, RatioOfFirstWaveLenght=code_block_11.out3, RatioOfSecondWaveLenght=code_block_11.out4)
code_block_12 = CodeBlock(polycurve=harmonic_2.polycurve) { polycurve; }
code_block_13 = CodeBlock(points=harmonic_2.points) { points; }

# group: Rotate 45
YZ = Plane.YZ()
code_block_14 = CodeBlock { 45; }
rotate = Geometry.Rotate(code_block_12, YZ, code_block_14)
code_block_15 = CodeBlock(polycurve=rotate) { polycurve; }
YZ_2 = Plane.YZ()
code_block_16 = CodeBlock { 45; }
rotate_2 = Geometry.Rotate(code_block_13, YZ_2, code_block_16)
code_block_17 = CodeBlock(points=rotate_2) { points; }
XZ = Plane.XZ()
