# Dynamo graph Final.dyn (Dynamo 1.3.3.4111)

# group: Parameters of BoundryBox
lenght = CodeBlock { 360; }
width = CodeBlock { 250; }

# group: A Line ( Lenght=Lengh, XY plane on l/2<x<l/2)
code_block = CodeBlock(l=lenght) { point5 = Point.ByCoordinates(-l/2, 0, 0); point6 = Point.ByCoordinates(l/2, 0, 0); }
byStartPointEndPoint = Line.ByStartPointEndPoint(startPoint=code_block.point5, endPoint=code_block.point6)

# group: distance between the panels
distance_between_slices = CodeBlock { 3; }

# group: list of numbers between end and start of box, divided by interval "DistanceBetweenSlice"
code_block_2 = CodeBlock(len=lenght, Dis=distance_between_slices) { -len/2..len/2..Dis; }

# group: PointsOnLinebased on number
count = List.Count(code_block_2)
code_block_3 = CodeBlock(n=count) { 0..1..#n; }
pointAtParameter = Curve.PointAtParameter(curve=byStartPointEndPoint, param=code_block_3)

# group: Slicing Planes
byOrigin = CoordinateSystem.ByOrigin(pointAtParameter)
XYPlane = CoordinateSystem.XYPlane(byOrigin)
YZPlane = CoordinateSystem.YZPlane(byOrigin)

# group: Create Half of Eclipse on XY plane
code_block_4 = CodeBlock(x=lenght) { x/2; }
code_block_5 = CodeBlock { 0; 180; }
byPlaneRadiiAngles = EllipseArc.ByPlaneRadiiAngles(arg1=code_block_4, arg2=width, arg3=code_block_5.out0, arg4=code_block_5.out1)
intersect = Geometry.Intersect(geometry=byPlaneRadiiAngles, other=YZPlane@L1)

# group: ListOfPointsOnEclipse
code_block_6 = CodeBlock { 1; }
flatten = List.Flatten(list=intersect, amt=code_block_6)

# group: Under Curves at Ellipse level(Not used)
create = List.Create(pointAtParameter, flatten)
transpose = List.Transpose(create)
code_block_7 = CodeBlock { 1; }
byControlPoints = NurbsCurve.ByControlPoints(transpose, code_block_7)

# group: list of numbers between end and start of box, divided by interval "DistanceBetweenSlice"
code_block_8 = CodeBlock(len=lenght, Dis=distance_between_slices) { -len/2..len/2..Dis; }

# group: Botttom Curve
code_block_9 = CodeBlock { 10; 2; 70; 0.2; 1; }
harmonic = Custom[Harmonic](xValueOfPoints=code_block_8, NumberOfCyclesFirstWave=code_block_9.out0, NumberOfCyclesSecondWave=code_block_9.out1, HeightOfCurve=code_block_9.out2, RatioOfFirstWaveLenght=code_block_9.out3, RatioOfSecondWaveLenght=code_block_9.out4)  # Creating harmonic waves by combining Cos waves
code_block_10 = CodeBlock(points=harmonic.points) { points; }
code_block_11 = CodeBlock(polycurve=harmonic.polycurve) { polycurve; }

# group: Back Curves
create_2 = List.Create(pointAtParameter, code_block_10)
transpose_2 = List.Transpose(create_2)
code_block_12 = CodeBlock { 1; }
byControlPoints_2 = NurbsCurve.ByControlPoints(transpose_2, code_block_12)

# group: Middle Curve
code_block_13 = CodeBlock { 10; 2; 120; 0.1; 0.5; }
harmonic_2 = Custom[Harmonic](xValueOfPoints=code_block_8, NumberOfCyclesFirstWave=code_block_13.out0, NumberOfCyclesSecondWave=code_block_13.out1, HeightOfCurve=code_block_13.out2, RatioOfFirstWaveLenght=code_block_13.out3, RatioOfSecondWaveLenght=code_block_13.out4)
code_block_14 = CodeBlock(points=harmonic_2.points) { points; }
code_block_15 = CodeBlock(polycurve=harmonic_2.polycurve) { polycurve; }

# group: Rotate 45
YZ = Plane.YZ()
code_block_16 = CodeBlock { 45; }
rotate = Geometry.Rotate(code_block_14, YZ, code_block_16)
code_block_17 = CodeBlock(points=rotate) { points; }
YZ_2 = Plane.YZ()
code_block_18 = CodeBlock { 45; }
rotate_2 = Geometry.Rotate(code_block_15, YZ_2, code_block_18)
code_block_19 = CodeBlock(polycurve=rotate_2) { polycurve; }
XZ = Plane.XZ()

# group: Front Curves
create_3 = List.Create(flatten, code_block_17, code_block_10)
transpose_3 = List.Transpose(create_3)
code_block_20 = CodeBlock { 2; }
byControlPoints_3 = NurbsCurve.ByControlPoints(transpose_3, code_block_20)

# group: Calculating Front point of Hob ( Translate)
hob_Height_Balcony_Height = CodeBlock { 40; }
byCoordinates = Vector.ByCoordinates(z=hob_Height_Balcony_Height)
translate = Geometry.Translate(geometry=flatten, direction=byCoordinates)

# group: FrontOfBalconyCurves
create_4 = List.Create(flatten, translate)
transpose_4 = List.Transpose(create_4)
code_block_21 = CodeBlock { 1; }
byControlPoints_4 = NurbsCurve.ByControlPoints(transpose_4, code_block_21)

# group: Calculating Back-Top point of Hob ( Translate)
hob_Tickness = CodeBlock { -10; }
byCoordinates_2 = Vector.ByCoordinates(y=hob_Tickness)
translate_2 = Geometry.Translate(geometry=translate, direction=byCoordinates_2)

# group: Curves at top of Hob
create_5 = List.Create(translate, translate_2)
transpose_5 = List.Transpose(create_5)
code_block_22 = CodeBlock { 1; }
byControlPoints_5 = NurbsCurve.ByControlPoints(transpose_5, code_block_22)

# group: Calculating Back_BTM points of Hob ( Translate)
slab_Tickness = CodeBlock { -10; }
byCoordinates_3 = Vector.ByCoordinates(z=slab_Tickness)
translate_3 = Geometry.Translate(geometry=translate_2, direction=byCoordinates_3)

# group: Curves at back of Hob
create_6 = List.Create(translate_2, translate_3)
transpose_6 = List.Transpose(create_6)
code_block_23 = CodeBlock { 1; }
byControlPoints_6 = NurbsCurve.ByControlPoints(transpose_6, code_block_23)

# group: Calculating Back_Top point of Deck( Translate)
slab_Tickness_2 = CodeBlock { 30; }
byCoordinates_4 = Vector.ByCoordinates(z=slab_Tickness_2)
translate_4 = Geometry.Translate(geometry=pointAtParameter, direction=byCoordinates_4)

# group: Deck_Curves
create_7 = List.Create(translate_4, translate_3)
transpose_7 = List.Transpose(create_7)
code_block_24 = CodeBlock { 1; }
byControlPoints_7 = NurbsCurve.ByControlPoints(transpose_7, code_block_24)

# group: Back Curves betweenm top of deck and ellipselevel
create_8 = List.Create(pointAtParameter, translate_4)
transpose_8 = List.Transpose(create_8)
code_block_25 = CodeBlock { 1; }
byControlPoints_8 = NurbsCurve.ByControlPoints(transpose_8, code_block_25)

# group: Dynamo Geometry
dropItems = List.DropItems()  # unwired: list, amount
create_9 = List.Create(byControlPoints_2, byControlPoints_3, byControlPoints_4, byControlPoints_5, byControlPoints_6, byControlPoints_7, byControlPoints_8)
transpose_9 = List.Transpose(create_9)
code_block_26 = CodeBlock { 1; -1; }
dropItems_2 = List.DropItems(list=transpose_9, amount=code_block_26.out0)
dropItems_3 = List.DropItems(list=dropItems_2, amount=code_block_26.out1)
byJoinedCurves = PolyCurve.ByJoinedCurves(dropItems_3)
byPatch = Surface.ByPatch(byJoinedCurves)
code_block_27 = CodeBlock { 1.5; }
thicken = Surface.Thicken(surface=byPatch, thickness=code_block_27)
create_10 = List.Create()  # unwired: arg0

# group: Revit-Adoptive component
create_11 = List.Create(pointAtParameter, code_block_10, code_block_17, flatten, translate, translate_2, translate_3, translate_4)
scale_up = CodeBlock { 1; }
scale = Geometry.Scale(geometry=create_11, xamount=scale_up, yamount=scale_up, zamount=scale_up)  # frozen
transpose_10 = List.Transpose(scale)
family_types = FamilyTypes()
byPoints = AdaptiveComponent.ByPoints(points=transpose_10, familyType=family_types)
