# Dynamo graph Finishes script - no isovist.dyn (Dynamo 2.5.0.7460)
# packages: GenerativeDesign 1.0.9

# group: Input - width/depth of building
in_width_depth = IntegerSlider(35000, range=15000..50000 step 1000)  # graph input

convert_between_units = DynamoConvert(in_width_depth, MeasurementType="Length", FromConversion="Millimeters", ToConversion="Meters")
code_block = CodeBlock(x=convert_between_units) { area = x*x; limit = 50000; h = limit/area*1000; }
floor = Math.Floor(number=code_block.h)

# group: Output - height
OUT_Height = Watch(floor)  # graph output

gf_value = DoubleInput(100)
code_block_2 = CodeBlock(h=code_block.h) { Vector.ZAxis(); 0..h..3500; }
count = List.Count(list=code_block_2.out1)
climbing_value = DoubleInput(5)
floor_value = CodeBlock(g=gf_value, c=count, vg=climbing_value) { g..g+((c-1)*vg)..vg; }

# group: Input - property lines
IN_Boundary = DSModelElementSelection()  # 1 picked in the model; graph input

curves = Element.Curves(element=IN_Boundary)
byJoinedCurves = PolyCurve.ByJoinedCurves(curves=curves)
remember = Data.Remember(byJoinedCurves)
code_block_3 = CodeBlock(x=in_width_depth) { (x*-1)/2; }
offset = Curve.Offset(curve=remember, distance=code_block_3)
byPatch = Surface.ByPatch(closedCurve=offset)

# group: Input - UV values for building position
IN_U = DoubleSlider(0.548, range=0..1 step 0.001)  # graph input
IN_V = DoubleSlider(0.409, range=0..1 step 0.001)  # graph input

pointAtParameter = Surface.PointAtParameter(surface=byPatch, u=IN_U, v=IN_V)
translate = Geometry.Translate(geometry=pointAtParameter, direction=code_block_2.out0, distance=code_block_2.out1)
code_block_4 = CodeBlock { Vector.YAxis(); Vector.ZAxis(); 0..360..10; }
rotate = Vector.Rotate(vector=code_block_4.out0, axis=code_block_4.out1, degrees=code_block_4.out2)
code_block_5 = CodeBlock { 1000000; }
byStartPointDirectionLength = Line.ByStartPointDirectionLength(startPoint=translate, direction=rotate, length=code_block_5, lacing=CrossProduct)

# group: Input - site buildings as generic model
IN_Context = DSModelElementSelection()  # 1 picked in the model; graph input

geometry = Element.Geometry(element=IN_Context)
byUnion = Solid.ByUnion(solids=geometry)
remember_2 = Data.Remember(byUnion)
doesIntersect = Geometry.DoesIntersect(geometry=byStartPointDirectionLength, other=remember_2)
countFalse = List.CountFalse(list=doesIntersect@L2)
mul = floor_value * countFalse
sum = Math.Sum(values=mul)
floor_2 = Math.Floor(number=sum)

# group: Output - yield
OUT_Score = Watch(floor_2)  # graph output

# group: Site geometry preview
code_block_6 = CodeBlock { 125; 255; }
byARGB = Color.ByARGB(a=code_block_6.out0, r=code_block_6.out0, g=code_block_6.out0, b=code_block_6.out1)
byGeometryColor = Modifiers.GeometryColor.ByGeometryColor(geometry=remember_2, color=byARGB)

# group: Property lines preview
code_block_7 = CodeBlock { 255; 0; }
byARGB_2 = Color.ByARGB(a=code_block_7.out0, r=code_block_7.out0, g=code_block_7.out1, b=code_block_7.out1)
byGeometryColor_2 = Modifiers.GeometryColor.ByGeometryColor(geometry=remember, color=byARGB_2, lacing=Longest)

ZAxis = Vector.ZAxis()
byOriginNormal = Plane.ByOriginNormal(origin=pointAtParameter, normal=ZAxis)
byWidthLength = Rectangle.ByWidthLength(cs=byOriginNormal, width=in_width_depth, length=in_width_depth)
ZAxis_2 = Vector.ZAxis()
extrudeAsSolid = Curve.ExtrudeAsSolid(curve=byWidthLength, direction=ZAxis_2, distance=code_block.h)

# group: Building preview
code_block_8 = CodeBlock { 255; 0; }
byARGB_3 = Color.ByARGB(a=code_block_8.out0, r=code_block_8.out1, g=code_block_8.out1, b=code_block_8.out0)
byGeometryColor_3 = Modifiers.GeometryColor.ByGeometryColor(geometry=extrudeAsSolid, color=byARGB_3, lacing=Longest)
