# Dynamo graph 02_GenerativeDesign_SetPanelTypes_End.dyn "01_GenerativeDesign_SetPanelTypes_End" (Dynamo 2.6.1.8786)
# packages: GenerativeDesign.Revit 1.6.4.0, Refinery Toolkit 1.1.1, GenerativeDesign 1.6.4.0, Clockwork for Dynamo 2.x 2.3.0

# group: Input
# note: For selection and whatnot

# group: Background
# note: For workflow

# group: Control
# note: For sliders and other options

# group: To Revit
# note: For changes made to Revit

# group: Annotation
# note: For notes and titles

# group: Info
# note: For general Information

# group: Other
# note: For general other needs

# group: License
# note: GNU License
# This program is free software: you can redistribute it and/or modify it under the terms of the GNU General Public License as published by the Free Software Foundation, either version 3 of the License, or (at your option) any later version.
# This program is distributed in the hope that it will be useful, but WITHOUT ANY WARRANTY; without even the implied warranty of MERCHANTABILITY or FITNESS FOR A PARTICULAR PURPOSE. See the GNU General Public License for more details.
# You should have received a copy of the GNU General Public License along with this program. If not, see http://www.gnu.org/licenses/

# group: User Inputs
select_feature_wall = DSModelWallSelection()  # 1 picked in the model; graph input
option = DoubleSlider(0, range=0..100 step 1)  # graph input

# group: Get Curtain Panels and Convert to Family Instances
byElement = CurtainPanel.ByElement(hostingElement=select_feature_wall)
asFamilyInstance = CurtainPanel.AsFamilyInstance(curtainPanel=byElement)

# group: Panel types to use
select_system_panels_to_use = CodeBlock()
# ---------- select_system_panels_to_use.designscript (3 lines) ----------
Revit.Elements.FamilyType.ByName("Panel_01");
Revit.Elements.FamilyType.ByName("Panel_02");
Revit.Elements.FamilyType.ByName("Panel_03");
# ----------------------------------------
list_create = List.Create(item0=select_system_panels_to_use.out0, item1=select_system_panels_to_use.out1, item2=select_system_panels_to_use.out2)

# group: Cache the ElementId
id = Element.Id(element=list_create)
remember = Data.Remember(id)

# group: Shuffle up the id numbers for later use
count = List.Count(list=asFamilyInstance)
remember_2 = Data.Remember(count)
cycle = List.Cycle(list=remember, amount=remember_2)
seededShuffle = Autodesk.RefineryToolkits.SpacePlanning.Rank.ListShuffle.SeededShuffle(list=cycle, seed=option)
takeItems = List.TakeItems(list=seededShuffle, amount=remember_2)

# group: Set the types
gate = Data.Gate(false, takeItems)
code_block = CodeBlock(id=gate) { Revit.Elements.ElementSelector.ByElementId(id); }
setType = Custom[FamilyInstance.SetType](familyInstance=asFamilyInstance, familyType=code_block)  # package Clockwork for Dynamo 2.x; Changes the family type of a given family instance to the specified type

# group: Extract geometry for preview for Generative Design
boundaries = CurtainPanel.Boundaries(curtainPanel=byElement)
remember_3 = Data.Remember(boundaries)
byPatch = Surface.ByPatch(closedCurve=remember_3)
flatten = List.Flatten(list=byPatch)

# group: Build a color lookup dictionary based on the id of the panel
code_block_2 = CodeBlock { "Material"; }
getParameterValueByName = Element.GetParameterValueByName(element=list_create, parameterName=code_block_2)
color = Material.Color(material=getParameterValueByName)

# group: Cache the color
remember_4 = Data.Remember(color)

# group: Color lookup dictionary
string_from_object = FromObject(obj=remember)
byKeysValues = DesignScript.Builtin.Dictionary.ByKeysValues(keys=string_from_object, values=remember_4)

# group: Obtain the color from the dictionary for preview
string_from_object_2 = FromObject(obj=takeItems)
valueAtKey = DesignScript.Builtin.Dictionary.ValueAtKey(dictionary=byKeysValues, key=string_from_object_2)
byGeometryColor = Modifiers.GeometryColor.ByGeometryColor(geometry=flatten, color=valueAtKey)

# group: Output
count_2 = List.Count(list=byGeometryColor)
amount_of_panels_modified = Watch(count_2)  # graph output
