# Dynamo graph Finished script - isovist.dyn (Dynamo 2.5.0.7460)
# packages: GenerativeDesign 1.0.9, Refinery Toolkit for Space Planning 1.0.0

# group: Input - width/depth of building
in_width_depth = IntegerSlider(23000, range=15000..50000 step 1000)  # graph input

convert_between_units = DynamoConvert(in_width_depth, MeasurementType="Length", FromConversion="Millimeters", ToConversion="Meters")
code_block = CodeBlock(x=convert_between_units) { area = x*x; limit = 50000; h = limit/area*1000; }
floor = Math.Floor(number=code_block.h)

# group: Output - height
OUT_Height = Watch(floor)  # graph output

# group: Input - site buildings as generic model
IN_Context = DSModelElementSelection()  # 1 picked in the model; graph input

geometry = Element.Geometry(element=IN_Context)
byUnion = Solid.ByUnion(solids=geometry)
remember = Data.Remember(byUnion)

# group: Site geometry preview
code_block_2 = CodeBlock { 125; 255; }
byARGB = Color.ByARGB(a=code_block_2.out0, r=code_block_2.out0, g=code_block_2.out0, b=code_block_2.out1)
byGeometryColor = Modifiers.GeometryColor.ByGeometryColor(geometry=remember, color=byARGB)

# group: Input - property lines
IN_Boundary = DSModelElementSelection()  # 1 picked in the model; graph input

curves = Element.Curves(element=IN_Boundary)
byJoinedCurves = PolyCurve.ByJoinedCurves(curves=curves)
remember_2 = Data.Remember(byJoinedCurves)

# group: Property lines preview
code_block_3 = CodeBlock { 255; 0; }
byARGB_2 = Color.ByARGB(a=code_block_3.out0, r=code_block_3.out0, g=code_block_3.out1, b=code_block_3.out1)
byGeometryColor_2 = Modifiers.GeometryColor.ByGeometryColor(geometry=remember_2, color=byARGB_2, lacing=Longest)

code_block_4 = CodeBlock(x=in_width_depth) { (x*-1)/2; }
offset = Curve.Offset(curve=remember_2, distance=code_block_4)
byPatch = Surface.ByPatch(closedCurve=offset)

# group: Input - UV values for building position
IN_U = DoubleSlider(0.548, range=0..1 step 0.001)  # graph input
IN_V = DoubleSlider(0.409, range=0..1 step 0.001)  # graph input

pointAtParameter = Surface.PointAtParameter(surface=byPatch, u=IN_U, v=IN_V)
ZAxis = Vector.ZAxis()
byOriginNormal = Plane.ByOriginNormal(origin=pointAtParameter, normal=ZAxis)
byWidthLength = Rectangle.ByWidthLength(cs=byOriginNormal, width=in_width_depth, length=in_width_depth)
ZAxis_2 = Vector.ZAxis()
extrudeAsSolid = Curve.ExtrudeAsSolid(curve=byWidthLength, direction=ZAxis_2, distance=code_block.h)

# group: Building preview
code_block_5 = CodeBlock { 255; 0; }
byARGB_3 = Color.ByARGB(a=code_block_5.out0, r=code_block_5.out1, g=code_block_5.out1, b=code_block_5.out0)
byGeometryColor_3 = Modifiers.GeometryColor.ByGeometryColor(geometry=extrudeAsSolid, color=byARGB_3, lacing=Longest)

code_block_6 = CodeBlock(h=code_block.h) { Vector.ZAxis(); 0..h..3500; }
translate = Geometry.Translate(geometry=pointAtParameter, direction=code_block_6.out0, distance=code_block_6.out1)
integer_slider = IntegerSlider(12, range=0..100 step 1)
code_block_7 = CodeBlock { 150000; }
byCenterPointRadius = Circle.ByCenterPointRadius(centerPoint=translate, radius=code_block_7)
code_block_8 = CodeBlock { 15; }
regularPolygon = Polygon.RegularPolygon(circle=byCenterPointRadius, numberSides=code_block_8)
ZAxis_3 = Vector.ZAxis()
byOriginNormal_2 = Plane.ByOriginNormal(origin=translate, normal=ZAxis_3)
intersect = Geometry.Intersect(geometry=byOriginNormal_2, other=byUnion)
perimeterCurves = Surface.PerimeterCurves(surface=intersect)
startPoint = Curve.StartPoint(curve=perimeterCurves)
byPoints = Polygon.ByPoints(points=startPoint)
code_block_9 = CodeBlock(x=translate, i=integer_slider, y=regularPolygon, z=byPoints) { x[i]; y[i]; z[i]; }
isovistFromPoint = Autodesk.RefineryToolkits.SpacePlanning.Analyze.Visibility.IsovistFromPoint(point=code_block_9.out0, boundary=code_block_9.out1, obstructions=code_block_9.out2)
code_block_10 = CodeBlock { 255; 125; 0; }
byARGB_4 = Color.ByARGB(a=code_block_10.out1, r=code_block_10.out0, g=code_block_10.out0, b=code_block_10.out2)
byGeometryColor_4 = Modifiers.GeometryColor.ByGeometryColor(geometry=isovistFromPoint, color=byARGB_4)
