# Dynamo graph 01_DynamoPlayer_SetPanelTypes_End.dyn (Dynamo 2.6.1.8786)
# packages: GenerativeDesign.Revit 1.6.4.0, Refinery Toolkit 1.1.1, Clockwork for Dynamo 2.x 2.3.0

# group: Input
# note: For selection and whatnot

# group: Background
# note: For workflow

# group: Control
# note: For sliders and other options

# group: To Revit
# note: For changes made to Revit

# group: Annotation
# note: For notes and titles

# group: Info
# note: For general Information

# group: Other
# note: For general other needs

# group: License
# note: GNU License
# This program is free software: you can redistribute it and/or modify it under the terms of the GNU General Public License as published by the Free Software Foundation, either version 3 of the License, or (at your option) any later version.
# This program is distributed in the hope that it will be useful, but WITHOUT ANY WARRANTY; without even the implied warranty of MERCHANTABILITY or FITNESS FOR A PARTICULAR PURPOSE. See the GNU General Public License for more details.
# You should have received a copy of the GNU General Public License along with this program. If not, see http://www.gnu.org/licenses/

# group: User Inputs
select_feature_wall = DSModelWallSelection()  # 1 picked in the model; graph input
option = DoubleSlider(0, range=0..100 step 1)  # graph input

# group: Get Curtain Panels and Convert to Family Instances
byElement = CurtainPanel.ByElement(hostingElement=select_feature_wall)
asFamilyInstance = CurtainPanel.AsFamilyInstance(curtainPanel=byElement)

# group: Panel types to use
select_system_panels_to_use = CodeBlock()
# ---------- select_system_panels_to_use.designscript (3 lines) ----------
Revit.Elements.FamilyType.ByName("Panel_01");
Revit.Elements.FamilyType.ByName("Panel_02");
Revit.Elements.FamilyType.ByName("Panel_03");
# ----------------------------------------
list_create = List.Create(item0=select_system_panels_to_use.out0, item1=select_system_panels_to_use.out1, item2=select_system_panels_to_use.out2)

# group: Shuffle panel types (by option) and take the amount needed
count = List.Count(list=asFamilyInstance)
cycle = List.Cycle(list=list_create, amount=count)
seededShuffle = Autodesk.RefineryToolkits.SpacePlanning.Rank.ListShuffle.SeededShuffle(list=cycle, seed=option)
takeItems = List.TakeItems(list=seededShuffle, amount=count)

# group: Set the types
setType = Custom[FamilyInstance.SetType](familyInstance=asFamilyInstance, familyType=takeItems)  # package Clockwork for Dynamo 2.x; Changes the family type of a given family instance to the specified type
