# Grasshopper definition object.gh (Grasshopper 1.0.7)
# plug-ins: Human

# ---- group: Create
number_slider = Slider(116, range=0..1000)
number_slider_2 = Slider(1.97, range=0..10)
number_slider_3 = Slider(2, range=0..10)
number_slider_4 = Slider(4.95, range=0..10)
number_slider_5 = Slider(61, range=0..100)
number_slider_6 = Slider(126, range=0..1000)
number_slider_7 = Slider(21, range=0..100)
number_slider_8 = Slider(33, range=0..1000)

# ----
merge = Merge(Data1=158, Data2=number_slider_5, Data3=number_slider_6)
Z = UnitZ(Factor=number_slider)
Z_2 = UnitZ(Factor=number_slider_3)
division = Division(A=merge, B=2)
Z_3 = UnitZ(Factor=number_slider_8)
cir = Circle(Plane=PlaneXY(0, 0, 0), Radius=division)
neg = Negative(Value=Z_3)
division_2 = Division(A=Z, B=number_slider_4)
item = ListItem(List=cir, Index=0, Wrap=True)  # -> Item, Item1, Item2
move = Move(Geometry=item.Item1, Motion=Z)  # -> Geometry, Transform
move_2 = Move(Geometry=item.Item2, Motion=division_2)  # -> Geometry, Transform
move_3 = Move(Geometry=move.Geometry, Motion=neg)  # -> Geometry, Transform
move_4 = Move(Geometry=item.Item1, Motion=Z_2)  # -> Geometry, Transform
move_5 = Move(Geometry=item.Item1, Motion=neg)  # -> Geometry, Transform
area = Area(Geometry=move_3.Geometry)  # -> Area, Centroid
scale = Scale(Geometry=move_3.Geometry, Center=area.Centroid, Factor=number_slider_2)  # -> Geometry, Transform
merge_2 = Merge(Data1=move_4.Geometry, Data2=move_5.Geometry)
merge_3 = Merge(Data1=scale.Geometry, Data2=move_2.Geometry, Data3=move_4.Geometry)
divide = DivideCurve(Curve=merge_3, Count=number_slider_7, Kinks=False)  # -> Points, Tangents, Parameters
divide_2 = DivideCurve(Curve=merge_2, Count=number_slider_7, Kinks=False)  # -> Points, Tangents, Parameters
crv = Curve(item.Item2)
flip = FlipMatrix(Data=divide_2.Points)
flip_2 = FlipMatrix(Data=divide.Points)
area_2 = Area(Geometry=crv)  # -> Area, Centroid
divide_3 = DivideCurve(Curve=crv, Count=number_slider_7, Kinks=False)  # -> Points, Tangents, Parameters
intcrv = Interpolate(Vertices=flip_2, Degree=3, Periodic=False, KnotStyle=1)  # -> Curve, Length, Domain
fline = FitLine(Points=flip)
ln = Line(StartPoint=area_2.Centroid, EndPoint=divide_3.Points)
merge_4 = Merge(Data1=intcrv.Curve, Data2=fline)
vec = Vector(unitize(ln))
join = JoinCurves(Curves=merge_4, Preserve=False)  # -> flatten(Curves)
crv_2 = Curve(reparameterize(graft(join)))
multiplication = Multiplication(A=vec, B=Slider(12, range=0..20))
multiplication_2 = Multiplication(A=vec, B=Slider(5, range=0..20))
neg_2 = Negative(Value=multiplication)
crv_3 = Curve(reparameterize(crv_2))
move_6 = Move(Geometry=flatten(crv_3), Motion=neg_2)  # -> Geometry, Transform
move_7 = Move(Geometry=flatten(move_6.Geometry), Motion=multiplication_2)  # -> Geometry, Transform
merge_5 = Merge(Data1=simplify(graft(crv_3)), Data2=simplify(graft(move_6.Geometry)))
merge_6 = Merge(Data1=simplify(graft(move_6.Geometry)), Data2=simplify(graft(move_7.Geometry)))
loft = Loft(Curves=merge_6, Options={Adjust=False, Closed=False, LoftEnds=0, LoftSimp=0, LoftType=0, Rebuild=10, Refit=0.01})
loft_2 = Loft(Curves=merge_5, Options={Adjust=False, Closed=False, LoftEnds=0, LoftSimp=0, LoftType=0, Rebuild=10, Refit=0.01})
facen = FaceNormals(Mesh=flatten(loft))  # -> Centers, Normals
item_2 = ListItem(List=facen.Normals, Index=0, Wrap=True)
vec_2 = Vector(unitize(item_2))
multiplication_3 = Multiplication(A=vec_2, B=number_slider_3)
extr = Extrude(Base=loft_2, Direction=multiplication_3)
move_8 = Move(Geometry=extr, Motion=expr("-x", neg))  # -> Geometry, Transform
xy = XYPlane(Origin=Point(0, 0, 0))
mirror = Mirror(Geometry=move_8.Geometry, Plane=xy)  # -> Geometry, Transform

preview = CustomPreview(Geometry=mirror.Geometry, Material=ColourSwatch(SwatchColor=RGB(186, 186, 186)))
bake = BakeGeometry(Bake=Toggle(False), Geometry=mirror.Geometry, DeleteOldBakes=False, PreserveTrees=False)
