# Dynamo graph 001.dyn (Dynamo 1.3.3.4111)

code_block = CodeBlock { 40; 2; 970; 0.2; 1; }
harmonic = Custom[Harmonic](NumberOfCyclesFirstWave=code_block.out0, NumberOfCyclesSecondWave=code_block.out1, HeightOfCurve=code_block.out2, RatioOfFirstWaveLenght=code_block.out3, RatioOfSecondWaveLenght=code_block.out4)  # frozen; Creating harmonic waves by combining Cos waves; unwired: xValueOfPoints
code_block_2 = CodeBlock(points=harmonic.points) { points; }
code_block_3 = CodeBlock(polycurve=harmonic.polycurve) { polycurve; }
