# Dynamo custom node Harmonic.dyf (Dynamo 1.3.2.2480)
# category: Analyze
# Creating harmonic waves by combining Cos waves

numberOfCycle = CodeBlock { 2; }
constant_ratio_of_full_height_to = CodeBlock { 1; }  # "Constant ratio of full height to the wave"
constant_ratio_of_full_height_to_2 = CodeBlock { 0.2; }  # "Constant ratio of full height to the wave"
height_is_a_function_of_this = CodeBlock { 70; }
numberOfCycle_2 = CodeBlock { 10; }
xValueOfPoints = Input()
code_block = CodeBlock(x=xValueOfPoints) { x; }
NumberOfCyclesFirstWave = Input()
code_block_2 = CodeBlock(NumberOfCycles=NumberOfCyclesFirstWave) { NumberOfCycles; }
PI = Math.PI()
count = List.Count(code_block)
code_block_3 = CodeBlock(Cyc=code_block_2, pi=PI, num=count) { 0..Cyc*pi..#num; }
radiansToDegrees = Math.RadiansToDegrees(code_block_3)
cos = Math.Cos(radiansToDegrees)
HeightOfCurve = Input()
code_block_4 = CodeBlock(HeightOfCurve=HeightOfCurve) { HeightOfCurve; }
RatioOfFirstWaveLenght = Input()
code_block_5 = CodeBlock(HeightOfCurve=RatioOfFirstWaveLenght) { HeightOfCurve; }
waveLenght = CodeBlock(totalHeight=code_block_4, propotion=code_block_5) { totalHeight*propotion; }
mul = cos * waveLenght
sub = mul - waveLenght
NumberOfCyclesSecondWave = Input()
code_block_6 = CodeBlock(NumberOfCycles=NumberOfCyclesSecondWave) { NumberOfCycles; }
PI_2 = Math.PI()
count_2 = List.Count(code_block)
code_block_7 = CodeBlock(Cyc=code_block_6, pi=PI_2, num=count_2) { 0..Cyc*pi..#num; }
radiansToDegrees_2 = Math.RadiansToDegrees(code_block_7)
cos_2 = Math.Cos(radiansToDegrees_2)
RatioOfSecondWaveLenght = Input()
waveLenght_2 = CodeBlock(totalHeight=code_block_4, propotion=RatioOfSecondWaveLenght) { totalHeight*propotion; }
mul_2 = cos_2 * waveLenght_2
sub_2 = mul_2 - waveLenght_2
add = sub + sub_2
code_block_8 = CodeBlock(d=code_block, t=add) { point5 = Point.ByCoordinates(d, 0, t); }
byPoints = PolyCurve.ByPoints(points=code_block_8)
polycurve = Output(byPoints)
code_block_9 = CodeBlock(points=code_block_8) { points; }
points = Output(code_block_9)
