# Grasshopper definition annual_daylight_speckle_example.gh (Grasshopper 1.0.7)
# plug-ins: Speckle 2

# ---- group: Iterations
panel = Panel("""0
15
45
60""")
# Iteration Preparation
number_slider = Slider(3, range=0..3)
item = ListItem(List=panel, Index=number_slider, Wrap=True)
num = Number(expr("x+1", number_slider))
concat = Concatenate(FragmentA="Iteration: ", FragmentB=num)

# ----
panel_2 = Panel(concat)

# ----
# Wea
panel_3 = Panel("https://energyplus-weather.s3.amazonaws.com/north_and_central_america_wmo_region_4/USA/MA/USA_MA_Boston-Logan.Intl.AP.725090_TMY3/USA_MA_Boston-Logan.Intl.AP.725090_TMY3.zip")
downloadepw = LBDownloadWeather(weather_URL=panel_3)  # -> epw_file, stat_file, ddy_file; plug-in component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
wea = HBWeaFromEPW(epw_file=downloadepw.epw_file)  # -> wea; plug-in component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

legendpar = LBLegendParameters(num_decimals="0")  # -> leg_par; plug-in component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

# ---- group: Apertures
# Geometry Preparation
brep = Brep([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])
glassmod = HBGlassModifier(name="g_material", trans="0.55")  # -> modifier; plug-in component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
rotate = Rotate(Geometry=brep, Angle=degrees(item), Plane=PlaneXY(0, 0, 0))  # -> Geometry, Transform
aperture = HBAperture(geo=rotate.Geometry, rad_mod=glassmod)  # -> report, apertures; plug-in component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

# ---- group: Opaque Faces
geo = Geometry([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])

# ----
rotate_2 = Rotate(Geometry=geo, Angle=degrees(item), Plane=PlaneXY(0, 0, 0))  # -> Geometry, Transform

# ---- group: Opaque Faces (continued)
roomsolid = HBRoomFromSolid(geo=flatten(rotate_2.Geometry), name="TestRoom", conditioned=True)  # -> report, rooms; plug-in component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

# ---- group: Apertures (continued)
addsubface = HBAddSubface(hb_obj=flatten(roomsolid.rooms), sub_faces=flatten(aperture.apertures))  # -> hb_obj; plug-in component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
bordershades = HBExtrudedBorderShades(hb_objs=flatten(addsubface), depth="0.3")  # -> report, hb_objs; plug-in component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

# ---- group: Context!
brep_2 = Brep([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])

# ----
rotate_3 = Rotate(Geometry=brep_2, Angle=degrees(item), Plane=PlaneXY(0, 0, 0))  # -> Geometry, Transform

# ---- group: Context! (continued)
shade = HBShade(geo=rotate_3.Geometry)  # -> report, shades; plug-in component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

# ----
# Model + Grids
panel_4 = Panel("sample_model_grid")
gridrooms = HBSensorGridFromRooms(rooms=bordershades.hb_objs, grid_size="0.5")  # -> grid, points, mesh; plug-in component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
model = HBModel(rooms=flatten(bordershades.hb_objs), shades=flatten(shade.shades), name=panel_4)  # -> report, model; plug-in component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
vizwiref = HBVisualizeWireframe(hb_objs=flatten(model.model))  # -> geo; plug-in component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
assigngridsviews = HBAssignGridsAndViews(model=model.model, grids=flatten(gridrooms.grid))  # -> model; plug-in component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

# ----
# Run Recipe
annualdaylight = HBAnnualDaylight(model=assigngridsviews, wea=wea, run=Toggle(True))  # -> report, results, DA, cDA, UDI, UDI_low, UDI_up; plug-in component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

# ----
# Visualize Hourly
# Illuminance for
# a Sensor
panel_5 = Panel("60")
pt = Point(gridrooms.points)
data = Data(annualdaylight.results)
bang = ExplodeTree(Data=pt)  # -> Branch0, Branch1
item_2 = ListItem(List=bang.Branch0, Index=panel_5, Wrap=True)
sph = Sphere(Base=item_2, Radius="0.5")
annualtodata = HBAnnualResultsToData(results=data, sel_pts=flatten(item_2), all_pts=pt)  # -> report, data; plug-in component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
hourlyplot = LBHourlyPlot(data=annualtodata.data, base_pt="50,0,0", legend_par=legendpar)  # -> report, mesh, legend, borders, labels, title, vis_set; plug-in component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

# ----
# Radiation Analysis / Results
panel_6 = Panel("3")
colrange = LBColorRange(index=panel_6)  # -> colors; plug-in component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
cumulativeradiation = HBCumulativeRadiation(model=assigngridsviews, wea=wea, run=Toggle(True))  # -> report, avg_irr, radiation; plug-in component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
legendpar_2 = LBLegendParameters(min="0", max="150", colors=colrange, num_decimals="0")  # -> leg_par; plug-in component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
mesh_join = MeshJoin(Meshes=flatten(gridrooms.mesh))
heatmap = LBSpatialHeatmap(values=flatten(cumulativeradiation.radiation), mesh=mesh_join, legend_par=legendpar_2, legend_title="kWh/m2")  # -> mesh, legend, title, colors, legend_par, vis_set; plug-in component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
avr = Average(Input=flatten(cumulativeradiation.radiation))
mesh = Mesh(heatmap.mesh)
geometry = Geometry(heatmap.legend)

mesh_join_2 = MeshJoin(Meshes=flatten(gridrooms.mesh))

# ----
# Overexposure Results
panel_7 = Panel("10")
sda = HBSpatialDaylightAutonomy(DA=flatten(annualdaylight.UDI_up), mesh=mesh_join_2, target_time=panel_7)  # -> out, sDA, pass_fail; plug-in component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
colrange_2 = LBColorRange(index="6")  # -> colors; plug-in component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
legendpar_3 = LBLegendParameters(min="0", max="100", colors=colrange_2, vert_or_horiz=Toggle(False))  # -> leg_par; plug-in component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
multiplication = Multiplication(A=sda.sDA, B=100)
round = Round(Number=multiplication)  # -> Nearest, Floor, Ceiling
concatenate = Concatenate(FragmentA="ASE (2000lux / 10% time) ", FragmentB=round.Nearest)
heatmap_2 = LBSpatialHeatmap(
    values=flatten(annualdaylight.UDI_up),
    mesh=mesh_join_2,
    legend_par=legendpar_3,
    legend_title="% of time",
    global_title=concatenate)  # -> simplify(mesh), simplify(legend), title, colors, legend_par, vis_set; plug-in component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
panel_8 = Panel(round.Nearest)
geometry_2 = Geometry(heatmap_2.legend)
mesh_2 = Mesh(heatmap_2.mesh)

# ----
# Compute sDA
sda_2 = HBSpatialDaylightAutonomy(DA=annualdaylight.DA)  # -> report, sDA, pass_fail; plug-in component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
sda_in_each_room = Panel(sda_2.sDA)
avr_2 = Average(Input=sda_2.sDA)

# ----
# Visualize Daylight Autonomy
mjoin = MeshJoin(Meshes=gridrooms.mesh)
data_2 = Data(flatten(annualdaylight.DA))
heatmap_3 = LBSpatialHeatmap(values=data_2, mesh=mjoin, legend_title="%")  # -> mesh, legend, title, colors, legend_par, vis_set; plug-in component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

# ----
# Convert to Speckle | Key:Value Pair
vizbytype = HBVisualizeByType(hb_objs=bordershades.hb_objs)  # -> walls, interior_walls, roofs, ceilings, exterior_floors, interior_floors, air_walls, apertures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; plug-in component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
panel_9 = Panel("""Walls
Interior Walls
Roofs
Ceilings
Exterior Floors
Interior Floors
Air Walls
Apertures
Interior Apertures
Doors
Interior Doors
Outdoor Shades
Indoor Shades
WireFrame""")
entwine = Entwine(
    Branch00=vizbytype.walls,
    Branch01=vizbytype.interior_walls,
    Branch02=vizbytype.roofs,
    Branch03=vizbytype.ceilings,
    Branch04=vizbytype.exterior_floors,
    Branch05=vizbytype.interior_floors,
    Branch06=vizbytype.air_walls,
    Branch07=vizbytype.apertures,
    Branch08=vizbytype.interior_apertures,
    Branch09=vizbytype.doors,
    Branch010=vizbytype.interior_doors,
    Branch011=vizbytype.outdoor_shades,
    Branch012=vizbytype.indoor_shades,
    FlattenInputs=True)  # -> simplify(Result)
clean = CleanTree(RemoveNulls=True, RemoveInvalid=True, RemoveEmpty=True, Tree=entwine)
tstat = TreeStatistics(Tree=clean)  # -> Paths, Length, Count
branch = TreeBranch(Tree=simplify(graft(panel_9)), Path=tstat.Paths, MaintainPaths=True)

to_speckle = ToSpeckle(Data=clean, selectedKitName="Objects")  # -> flatten(Base)
concat_2 = Concatenate(FragmentA="@", FragmentB=branch)  # -> flatten(Result)

csokv = CreateSpeckleObjectByKeyValue(Keys=concat_2, Values=to_speckle, selectedKitName="None")

# ----
# Convert to Speckle | Extend Speckle Object
to_speckle_2 = ToSpeckle(Data=heatmap_3.mesh, selectedKitName="Objects")
eso = ExtendSpeckleObject(DaylightAutonomyMesh=to_speckle_2, DaylightAutonomyResults=avr_2, selectedKitName="Objects")
to_speckle_3 = ToSpeckle(Data=mesh, selectedKitName="Objects")
eso_2 = ExtendSpeckleObject(RadiationAnalysis=to_speckle_3, RadiationResults=avr, selectedKitName="Objects")
to_speckle_4 = ToSpeckle(Data=mesh_2, selectedKitName="Objects")
eso_3 = ExtendSpeckleObject(OverexposureMesh=to_speckle_4, OverexposureResults=panel_8, selectedKitName="Objects")
concat_3 = Concatenate(FragmentA="Daylight Autonomy: ", FragmentB=avr_2)
panel_10 = Panel(concat_3)
concat_4 = Concatenate(FragmentA="Overexposure Results: ", FragmentB=panel_8, FragmentC="%")
panel_11 = Panel(concat_4)
concat_5 = Concatenate(FragmentA="Radiation Results: ", FragmentB=avr, FragmentC=" kWh/m2")
panel_12 = Panel(concat_5)
concat_6 = Concatenate(
    FragmentF=panel_2,
    FragmentG=" | ",
    FragmentA=panel_10,
    FragmentB=" | ",
    FragmentC=panel_11,
    FragmentD=" | ",
    FragmentE=panel_12)
create_iteration_name = Panel(concat_6)
cso = CreateSpeckleObject(BuildingGeometry=csokv, DaylightAutonomy=eso, Overexposure=eso_3, RadiationAnalysis=eso_2, selectedKitName="Objects")

list = Accounts(
    {"No account selected": , "Account (shuwei.zhang@mottmac.com | https://speckle.xyz)": "4384040d41", "Account (shuwei.zhang.v@gmail.com | https://speckle.xyz)": "ab9b614011"}, selected="Account (shuwei.zhang.v@gmail.com | https://speckle.xyz)",
    selectedId="ab9b614011",
    selectedServer="https://speckle.xyz")
panel_13 = Panel("https://speckle.xyz/streams/95d6f2a2ae/branches/demo/analysis")
sget = StreamGet(StreamIDURL=panel_13, Account=list)
send = Send(
    Stream=sget,
    Message=create_iteration_name,
    Data=flatten(cso),
    AutoSend=False,
    BaseId="05a05b7615792bf10a113e6f0a4ac95d",
    CurrentComponentState="up_to_date",
    KitName="Objects",
    OutputWrappers="https://speckle.xyz\t95d6f2a2ae\t90901a0e8c",
    UseDefaultCache=True,
    selectedKitName="Objects")
panel_14 = Panel(send)
